# Grasshopper definition Orographic_Ring_Generator.gh (Grasshopper 1.0.8)

# ---- group: CSV file
# https://re.jrc.ec.europa.eu/pvg_tools/en/
path = FilePath("C:\Users\jostr\Downloads\horizon_46.540_8.050.csv")

# ----
file = ReadFile(File=path, PerLineParse=True)
split = TextSplit(Text=file, Separators="\t")
flip = FlipMatrix(Data=split)
bang = ExplodeTree(Data=flip)  # -> Branch0, Branch1, Branch2, Branch3, Branch4, Branch5, Branch6, Branch7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
dom = ConstructDomain(DomainStart="4", DomainEnd="51")
panel = Panel(bang.Branch2)
range = Range(Domain=dom, Steps="48")
item = ListItem(List=panel, Index=range, Wrap=True)
panel_2 = Panel(item)

number_slider = Slider(100, range=0..1000)
rev = ReverseList(List=panel_2)
rad = Radians(Degrees=rev)
expression = Expression(x="7.5", Expression="Floor(360/x)")
tan = Tangent(Value=rad)
cir = Circle(Plane=PlaneXY(0, 0, 0), Radius=number_slider)
multiplication = Multiplication(A=number_slider, B=tan)
round = Round(Number=expression)  # -> Nearest, Floor, Ceiling
Z = UnitZ(Factor=1)
divide = DivideCurve(Curve=cir, Count=round.Floor, Kinks=False)  # -> graft(Points), Tangents, Parameters
amp = Amplitude(Vector=Z, Amplitude=multiplication)  # -> graft(Vector)
move = Move(Geometry=divide.Points, Motion=amp)  # -> flatten(Geometry), Transform
crv = Curve(cir)
item_2 = ListItem(List=flatten(divide.Points), Index=0, Wrap=True)
pline = PolyLine(Vertices=move.Geometry, Closed=Toggle(True))
crv_cp = CurveClosestPoint(Point=item_2, Curve=pline)  # -> Point, Parameter, Distance
seam = Seam(Curve=pline, Seam=crv_cp.Parameter)
rulesrf = RuledSurface(CurveA=crv, CurveB=seam)
rad_2 = Radians(Degrees="97.5")
rotate = Rotate(Geometry=rulesrf, Angle=rad_2, Plane=PlaneXY(0, 0, 0))  # -> Geometry, Transform

# ---- group: TERRAIN
brep = Brep(rotate.Geometry)

# ---- group: SVF (Sky View Factor)
projection = ValueList({"Orthographic", "Stereographic"}, selected="Stereographic")
symask = LBSkyMask(context=brep, density="3", projection=projection)  # -> report, context_mask, orient_mask, strategy_mask, sky_mask, context_view, orient_view, strategy_view, sky_view; plug-in component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
panel_3 = Panel(symask.sky_view)
